# Dynamo custom node DynamoChatGPT.dyf (Dynamo 2.12.1.8246)
# category: AECOder
# Custom node to use chat completion chatGPT API inside Dynamo.
# - Project information:
# https://github.com/mayconrfreitas/dynamo-chatgpt
# - ChatGPT API Reference:
# https://platform.openai.com/docs/api-reference/chat

api_key = Input(api_key: string)  # OpenAI API Key (required) - Tutorial: https://platform.openai.com/docs/quickstart
organization_id = Input(organization_id: string = "")  # Organization ID (optional) - Found here: https://platform.openai.com/settings/organization/general
project_id = Input(project_id: string = "")  # Project ID (optional) - Found here under 'Project > General': https://platform.openai.com/settings/organization/general
prompt = Input(prompt: string)  # Write your prompt here... (required)
model = Input(model: string = "gpt-3.5-turbo")  # Model (required) - Find about models here: https://platform.openai.com/docs/models
temperature = Input(temperature: int = 0)  # What sampling temperature to use, between 0 and 2. Higher values like 0.8 will make the output more random, while lower values like 0.2 will make it more focused and deterministic. We generally recommend altering this or top_p but not both.
max_tokens = Input(max_tokens: int = 4095)  # The maximum number of tokens that can be generated in the chat completion. The total length of input tokens and generated tokens is limited by the model's context length. - More information about tokens: https://platform.openai.com/tokenizer
top_p = Input(top_p: int = 1)  # An alternative to sampling with temperature, called nucleus sampling, where the model considers the results of the tokens with top_p probability mass. So 0.1 means only the tokens comprising the top 10% probability mass are considered. We generally recommend altering this or temperature but not both.
frequency_penalty = Input(frequency_penalty: int = 0)  # Number between -2.0 and 2.0. Positive values penalize new tokens based on their existing frequency in the text so far, decreasing the model's likelihood to repeat the same line verbatim. - More information: https://platform.openai.com/docs/guides/text-generation/parameter-details
presence_penalty = Input(presence_penalty: int = 0)  # Number between -2.0 and 2.0. Positive values penalize new tokens based on whether they appear in the text so far, increasing the model's likelihood to talk about new topics. - More information: https://platform.openai.com/docs/guides/text-generation/parameter-details
clear_history = Input(clear_history: bool = false)  # Clear chat history? If 'false', all your chat history will be sent (so more tokens) If 'true', it will clear the chat history before sending
python_script = Python(IN[0]=api_key, IN[1]=organization_id, IN[2]=project_id, IN[3]=prompt, IN[4]=model, IN[5]=temperature, IN[6]=max_tokens, IN[7]=top_p, IN[8]=frequency_penalty, IN[9]=presence_penalty, IN[10]=clear_history)  # IronPython2
# ---------- python_script.python (155 lines) ----------
"""
-----------------------------------
Created by Maycon Freitas
AECOder
www.aecoder.com.br
www.linkedin.com/in/maycon-freitas/
maycon.freitas@aecoder.com.br
-----------------------------------
"""


### Libraries ###
import os
import clr
import json
import sys
import urllib2
import traceback

clr.AddReference('RevitAPIUI')
from Autodesk.Revit.UI import *


### Classes ###
class OpenAIMessage:
	def __init__(self, message, role="user"):
		self.role = role
		self.content = [{
			"type": "text",
			"text": message
		}]
	
	def __dict__(self):
		return {
			"role": self.role,
			"content": self.content
		}


class OpenAIHistory:
	def __init__(self):
		self.messages = []
		self.path = os.getenv('APPDATA') + "\\AECOder\\dynamochatgpt\\history.json"
		if not os.path.exists(self.path):
			os.makedirs(os.path.dirname(self.path))
			self.save_to_file(self.path)
		else:
			self.load_from_file(self.path)
	
	def save_to_file(self, file_path):
		with open(file_path, 'w') as file:
			json.dump(self.messages, file)

	def load_from_file(self, file_path):
		with open(file_path, 'r') as file:
			try:
				self.messages = json.load(file)
			except:
				self.messages = []
				self.save_to_file(self.path)

	def add_message(self, message):
		self.messages.append(message.__dict__)
		self.save_to_file(self.path)

	def get_messages(self):
		self.load_from_file(self.path)
		return self.messages
	
	def clear(self):
		self.messages = []
		self.save_to_file(self.path)


class OpenAI:
	def __init__(self, api_key, organization_id="", project_id="", clear_history=False):
		self.api_key = api_key
		self.organization_id = organization_id
		self.project_id = project_id

		# Set the API key
		self.headers = {
			'Content-Type': 'application/json',
			'Authorization': 'Bearer ' + self.api_key
		}

		if self.organization_id != "":
			self.headers['OpenAI-Organization'] = self.organization_id

		if self.project_id != "":
			self.headers['OpenAI-Project'] = self.project_id
		
		self.history = OpenAIHistory()
		if clear_history:
			self.clear_history()


	def create_completion(self, prompt, model="gpt-4o", temperature=0, max_tokens=4095, top_p=1, frequency_penalty=0, presence_penalty=0):
		url = 'https://api.openai.com/v1/chat/completions'

		openai_message = OpenAIMessage(prompt)
		self.history.add_message(openai_message)

		data = "{ \"messages\": " + json.dumps(self.history.get_messages()) + ", \"model\": \"" + model + "\", \"temperature\": " + str(temperature) + ", \"max_tokens\": " + str(max_tokens) + ", \"top_p\": " + str(top_p) + ", \"frequency_penalty\": " + str(frequency_penalty) + ", \"presence_penalty\": " + str(presence_penalty) + " }"

		req = urllib2.Request(url, data, self.headers)
		response = urllib2.urlopen(req)

		system_response = json.loads(response.read().decode('utf-8')).get('choices')[0].get('message').get('content')
		self.history.add_message(OpenAIMessage(system_response, "system"))

		return system_response

	def get_history(self):
		return self.history.get_messages()
	
	def clear_history(self):
		self.history.clear()


### Main ###
api_key = IN[0]
organization_id = IN[1]
project_id = IN[2]

prompt = IN[3]
model = IN[4]
temperature = IN[5]
max_tokens = IN[6]
top_p = IN[7]
frequency_penalty = IN[8]
presence_penalty = IN[9]
clear_history = bool(IN[10])

try:
	openai = OpenAI(api_key, organization_id, project_id, clear_history)

	if len(prompt) > 0:
		response = openai.create_completion(prompt, model, temperature, max_tokens, top_p, frequency_penalty, presence_penalty)
		OUT = response
	else:
		raise Exception("Prompt is empty")
	

except:
	try:
		msg = traceback.format_exception_only(sys.exc_info()[0], sys.exc_info()[1])[0].replace("Exception: ", "")
	except:
		msg = "An error has occurred. See details to get more information."
	errorReport = traceback.format_exc()
	taskDialog = TaskDialog("Error")
	taskDialog.MainInstruction = msg
	taskDialog.ExpandedContent = errorReport
	taskDialog.Show()
	OUT = errorReport
# ----------------------------------------
response = Output(python_script)
