# Dynamo graph sample_dynamo_chatgpt.dyn (Dynamo 2.12.1.8246)

# group: INPUTS
# note: Insert your prompt here
string = StringInput("Hi")  # graph input
# note: Insert your openAI API key here
string_2 = StringInput("")  # graph input
# note: True = Clear chat history
# False = Keep chat history
boolean = BoolSelector(false)

dynamoChatGPT = Custom[DynamoChatGPT](prompt=string, api_key=string_2, clear_history=boolean)  # Custom node to use chat completion chatGPT API inside Dynamo. - Project information: https://github.com/mayconrfreitas/dynamo-chatgpt - ChatGPT API Reference: https://platform.openai.com/docs/api-reference/chat

# group: Response
watch = Watch(dynamoChatGPT)  # graph output
